# Grasshopper definition grassflow_string formatter.gh (Grasshopper 1.0.5)

c_script = CSharpScript(act=Toggle(False))  # -> out, A; inputs act: Boolean
# ---------- c_script: C# ----------
    if(!act) return;

    string python = @"C:\Python27\python.exe";

    // python app to call
    string myPythonApp = @"C:\Users\user\Downloads\sum.py";

    // dummy parameters to send Python script
    int x = 2;
    int y = 5;

    // Create new process start info
    System.Diagnostics.ProcessStartInfo myProcessStartInfo = new System.Diagnostics.ProcessStartInfo(python);
    // make sure we can read the output from stdout
    myProcessStartInfo.UseShellExecute = false;
    myProcessStartInfo.RedirectStandardOutput = true;

    // start python app with 3 arguments
    myProcessStartInfo.Arguments = myPythonApp + " " + x + " " + y;

    System.Diagnostics.Process myProcess = new System.Diagnostics.Process();
    // assign start information to the process
    myProcess.StartInfo = myProcessStartInfo;

    // start the process
    myProcess.Start();

    // Read the standard output of the app we called.
    // in order to avoid deadlock we will read output first
    // and then wait for process terminate:
    System.IO.StreamReader myStreamReader = myProcess.StandardOutput;
    string myString = myStreamReader.ReadLine();
    //string myString = myStreamReader.ReadToEnd();

    /*if you need to read multiple lines, you might use:
    string myString = myStreamReader.ReadToEnd() */

    // wait exit signal from the app we called and then close it.
    myProcess.WaitForExit();
    myProcess.Close();

    // write the output we got from python app
    //Console.WriteLine("Value received from script: " + myString);
    A = myString;
# ---------- end c_script ----------
panel = Panel(c_script.A)
nu = Panel("""49.223
80.605
14.617
79.483
13.445
86.552
58.976
80.936
77.97
21.9""")
force = Panel("""-0.0085774
-0.0075548
-0.0013183
-0.0019713
-0.004171
-0.0053874
-0.008952
-0.0054559
-0.0085469
-0.007551""")
mu = Panel("""0.43441
0.17703
0.22462
0.47056
0.5276
0.2717
0.18409
0.39084
0.22421
0.17318""")
number_slider = Slider(20, range=0..100)
bnd = Bounds(Numbers=force)
bnd_2 = Bounds(Numbers=nu)
bnd_3 = Bounds(Numbers=mu)
random = Random(Range=bnd, Number=number_slider, Seed=expr("10", 2))
random_2 = Random(Range=bnd_3, Number=number_slider, Seed=1)
random_3 = Random(Range=bnd_2, Number=number_slider, Seed=5)
merge = Merge(Data1=simplify(graft(random_2)), Data2=simplify(graft(random_3)), Data3=simplify(graft(random)))
# flatten,Dense:nodes=512:activation=relu,Dropout:rate=0.2,Dense:nodes=10:activation=softmax
panel_2 = Panel("C:\Users\user\Downloads\SAFE output From Hanshen\SAFE output From Hanshen\Simple model dataset\Simple Model New_M1.csv")
ins = InsertItems(List=graft(merge), Item=",", Indices=1, Wrap=True)  # -> simplify(List)
layers_flatten = CSharpScript()  # -> out, A; inputs input: String
# ---------- layers_flatten: C# ----------
    A = "Flatten";
# ---------- end layers_flatten ----------
pshift = ShiftPaths(Data=ins, Offset=-1)
layers_dense = CSharpScript(x=layers_flatten.A, paramA="512", activation="relu")  # -> out, A; inputs paramA: String, activation: String
# ---------- layers_dense: C# ----------
    A = x + "," + "Dense:units=" + paramA + ":" + "activation=" + activation;
# ---------- end layers_dense ----------
cull_i = CullIndex(List=pshift, Indices=-1, Wrap=True)
join = TextJoin(Text=cull_i)  # -> flatten(Result)
layers_dropout = CSharpScript(x=layers_dense.A, percentage="0.2")  # -> out, A; inputs percentage: String
# ---------- layers_dropout: C# ----------
    A = x + "," + "Dropout:rate=" + percentage;
# ---------- end layers_dropout ----------
panel_3 = Panel(join)
layers_dense_2 = CSharpScript(x=layers_dropout.A, paramA="10", activation="softmax")  # -> out, A; inputs paramA: String, activation: String; same code as layers_dense
model_compile = CSharpScript(
    modelType="Sequential",
    layers=layers_dense_2.A,
    optimizer="adam",
    loss="sparse_categorical_crossentropy",
    metrics="accuracy",
    filePath=panel_2,
    pyPath="C:\Users\user\Downloads\sum.py",
    inputData=join,
    train=Toggle(False))  # -> out, A, B; inputs modelType: String, layers: String, optimizer: String, loss: String, metrics: String, filePath: String, pyPath: String, inputData: list of String, train: Boolean
# ---------- model_compile: C# ----------
    List<string> outputStr = new List<string>();
    //    string layerStr = modelType + "[" + layers + "]";
    //    string compileStr = "Compiler" + "[{" + optimizer + "},{" + loss + "},{" + metrics + "}]";
    string layerStr = layers;
    //string compileStr = "optimizer:" + optimizer + "," + "loss:" + loss + "," + "metrics:" + metrics;
    outputStr.Add(layerStr);
    outputStr.Add(optimizer + ":" + "learning_rate=0.01");
    outputStr.Add("loss:" + loss);
    //    outputStr.Add("metrics:" + metrics + ",");
    outputStr.Add(filePath);
    foreach(string s in inputData)
    {
      outputStr.Add(s);
    }


    A = outputStr;


    // python
    if(!train) return;

    string python = @"C:\Python27\python.exe";

    // python app to call
    string myPythonApp = pyPath;

    // dummy parameters to send Python script
    int x = 2;
    int y = 5;

    // Create new process start info
    System.Diagnostics.ProcessStartInfo myProcessStartInfo = new System.Diagnostics.ProcessStartInfo(python);
    // make sure we can read the output from stdout
    myProcessStartInfo.UseShellExecute = false;
    myProcessStartInfo.RedirectStandardOutput = true;

    // start python app with 3 arguments
    myProcessStartInfo.Arguments = myPythonApp + " " + x + " " + y;

    System.Diagnostics.Process myProcess = new System.Diagnostics.Process();
    // assign start information to the process
    myProcess.StartInfo = myProcessStartInfo;

    // start the process
    myProcess.Start();

    // Read the standard output of the app we called.
    // in order to avoid deadlock we will read output first
    // and then wait for process terminate:
    System.IO.StreamReader myStreamReader = myProcess.StandardOutput;
    string myString = myStreamReader.ReadLine();
    //string myString = myStreamReader.ReadToEnd();

    /*if you need to read multiple lines, you might use:
    string myString = myStreamReader.ReadToEnd() */

    // wait exit signal from the app we called and then close it.
    myProcess.WaitForExit();
    myProcess.Close();

    // write the output we got from python app
    //Console.WriteLine("Value received from script: " + myString);
    B = myString;
# ---------- end model_compile ----------
panel_4 = Panel(model_compile.B)
panel_5 = Panel(model_compile.A)
panel_6 = Panel(layers_dense_2.A)
